# Grasshopper definition fabrication_manager_v2.ghx (Grasshopper 1.0.8)
# plug-ins: RhinoCodePluginGH

reload = Button()
reload_2 = Python3Script(reload=reload)
# ---------- reload_2: Python ----------
if reload:
    from compas_rhino import unload_modules
    unload_modules("fabrication_manager")
    unload_modules('ur_fabrication_control')
# ---------- end reload_2 ----------

tasks = Python3Script(create=Toggle(True))  # -> out, tasks
# ---------- tasks: Python ----------
import time
from fabrication_manager.task import Task

class Task1(Task):
    def work_func(self, results, interrupt_event):
        # do something
        self.log("This is task 1")
        time.sleep(0.5)

class Task2(Task):
    def work_func(self, results, interrupt_event):
        # do something
        self.log("Task 2 counting up")
        for i in range(10):
            self.log("Counting: {}".format(i))
            time.sleep(0.1)

class Task3(Task):
    def work_func(self, results, interrupt_event):
        # do something
        self.log("Task 3 starting...")
        current_time = time.time()
        while time.time()<(current_time+1):
            self.log("waiting...")
        else:
            self.log("done waiting!")

if create:
    task1 = Task(key=0)
    task2 = Task(key=1)
    task3 = Task(key=2)

tasks = [task1, task2, task3]
# ---------- end tasks ----------

# ---- group: test individual task
# INDIVIDUAL TASK EXECUTION
toggle = BooleanToggle(True)
py3 = Python3Script(create=toggle)  # -> out, results, interrupt_event
# ---------- py3: Python ----------
from multiprocessing import Queue, Event

if create:
    results = Queue()
    interrupt_event = Event()
# ---------- end py3 ----------
py3_2 = Python3Script(interrupt_event=py3.interrupt_event, set_flag=Toggle(False))  # -> out
# ---------- py3_2: Python ----------
if set_flag:
    interrupt_event.set()
else:
    interrupt_event.clear()

print(interrupt_event.is_set())
# ---------- end py3_2 ----------
trigger = Trigger(Interval=100, TimerInterval=100, Target=py3_3)  # disabled
py3_3 = Python3Script(
    tasks=tasks.tasks,
    results=py3.results,
    interrupt_event=py3.interrupt_event,
    idx=Slider(0, range=0..100),
    run=Button(),
    wait=Toggle(False),
    update=Toggle(True))  # -> out, a; inputs tasks: list, idx: Int32
# ---------- py3_3: Python ----------
import time
import multiprocessing

multiprocessing.set_executable(r"C:\Users\gido\.rhinocode\py39-rh8\python.exe")

if run:
    task = tasks[idx]
    task.reset()
    task.start(results, interrupt_event)
    if wait:
        task.join()

if update:
    if tasks[idx].process is not None and not tasks[idx].process.is_alive():
        tasks[idx].join()
    for i in range(10):
        try:
            msg = results.get_nowait()
            print("LOG:", msg)
        except:
            pass
    # print("Task {}: Running state={}".format(idx, tasks[idx].is_running))
    # print("Task {}: Completion state={}".format(idx, tasks[idx].is_completed))

# print(interrupt_event.is_set())
# print(tasks[idx].join())
# ---------- end py3_3 ----------
toggle_2 = BooleanToggle(True)
rec = DataRecorder(py3_3.out, DataLimit=-10, RecordData=True)
panel = Panel(rec)

# ----
# URTASK SPECIFIC
panel_2 = Panel("192.168.52.1")
# current observed latency (from initiation to fully completed) = 60 - 100 ms
panel_3 = Panel("8888")
server = Python3Script(start_server=Button(), ip_address=panel_2, port_number=panel_3)
# ---------- server: Python ----------
import os, pathlib
import subprocess
import fabrication_manager

python = pathlib.Path(os.__file__).parents[1] /'python.exe'
server = fabrication_manager.communication.run_server_remote.__file__

assert server

def start_script(ip, port):
    args = [python, server, "--ip", ip, "--port", str(port)]
    # args = [python, server]
    result = subprocess.Popen(args)
    print("Server process started with PID:", result.pid)
    # result.wait()

if start_server:
    start_script(ip_address, port_number)
# ---------- end server ----------
urtasks = Python3Script(create=Button(), robot_ip="192.168.52.128", robot_port="30002", server_ip=panel_2, server_port=panel_3)  # -> out, tasks; inputs robot_ip: String, robot_port: Int32, server_ip: String, server_port: Int32
# ---------- urtasks: Python ----------
import random
from ur_fabrication_control.direct_control.fabrication.urtask import TestURTask

# class TestURTask(URTask):
#     def create_urscript(self, results):
#         self.urscript.textmessage("Running Task", string=True)
#         waittime = random.randint(1, 5)
#         self.urscript.add_sleep(waittime)
#         results.put("URTask: Waited {}s".format(waittime))
#         results.put("URTask: Custom script created")

tasks = []
for i in range(5):
    urtask = TestURTask(None, (robot_ip, robot_port), key=i)
    urtask.send_feedback = True
    urtask.server_address = (server_ip, server_port)
    tasks.append(urtask)
# ---------- end urtasks ----------
py3_4 = Python3Script(create=Toggle(True))  # -> out, results, interrupt_event; same code as py3
py3_5 = Python3Script(tasks=urtasks.tasks, idx=Slider(0, range=0..100), results=py3_4.results)  # -> out, urscript; inputs tasks: list
# ---------- py3_5: Python ----------
tasks[0]._create_urscript(results)
urscript=tasks[0].urscript.generate()
# ---------- end py3_5 ----------
panel_4 = Panel(py3_5.urscript)

# ----
# FABRICATION MANAGER
set_tasks = Button()
stop_fabrication = Button()
reset_fabrication = Button()
start_fabrication = Button()
init = Button()
skip_task = Button()

clear = Button()
previous_task = Button()
fabrication = Python3Script(init=init, clear=clear, tasks=tasks.tasks, set_tasks=set_tasks)  # -> out, fabrication; inputs tasks: list
# ---------- fabrication: Python ----------
from scriptcontext import sticky as st
from fabrication_manager import FabricationManager
import multiprocessing 

multiprocessing.set_executable(r"C:\Users\gido\.rhinocode\py39-rh8\python.exe")

if init:
    fabrication = FabricationManager()
    st["fabrication"] = fabrication

if clear:
    st.pop("fabrication")

if "fabrication" not in st:
    fabrication = None
else:
    fabrication = st["fabrication"]

if set_tasks:
    print("setting tasks")
    fabrication.clear_tasks()
    fabrication.set_tasks(tasks)
# ---------- end fabrication ----------
py3_6 = Python3Script(
    fabrication=fabrication.fabrication,
    start=start_fabrication,
    stop=stop_fabrication,
    prev=previous_task,
    skip=skip_task,
    reset=reset_fabrication)  # -> out
# ---------- py3_6: Python ----------
if start:
    #if robot.is_connected(): #and arduino.is_connected():
    print("starting process")
    fabrication.start()

if prev:
    current_task = fabrication.get_next_task()
    if fabrication.tasks[current_task.key-1]:
        fabrication.tasks[current_task.key-1].reset()

if skip:
    current_task = fabrication.get_next_task()
    current_task.is_completed = True

if stop:
    print("stopping process")
    fabrication.stop()
    
if reset:
    print("resetting process")
    fabrication.reset()
# ---------- end py3_6 ----------

# ----
# State viewer
trigger_2 = Trigger(Interval=1000, TimerInterval=1000, Target=py3_7)  # disabled
py3_7 = Python3Script()  # -> out, state, num_tasks, num_current_task, num_tasks_left, log_messages
# ---------- py3_7: Python ----------
from scriptcontext import sticky as st

fabrication = st["fabrication"]

if fabrication.fab_process is not None:
    if fabrication.fab_process.is_alive():
        state = "PROCESS RUNNING"
    else:
        state = "PROCESS STOPPED"
else:
    state = "PROCESS UNAVAILABLE"

print(fabrication.get_next_task())
num_tasks = len(fabrication.tasks)
if fabrication.get_next_task() is not None:
    num_current_task = fabrication.get_next_task().key
    num_tasks_left = num_tasks-num_current_task
else:
    num_current_task = "NONE"
    num_tasks_left = "NONE"

for log in fabrication.poll_logs():
    print("LOG: ", log)

log_messages = fabrication.log_messages

#assembly = st["assembly"]
# ---------- end py3_7 ----------
state = Panel(py3_7.state)
num_tasks = Panel(py3_7.num_tasks)
num_current_task = Panel(py3_7.num_current_task)
num_tasks_left = Panel(py3_7.num_tasks_left)
log_messages = Panel(py3_7.log_messages)
